# Dynamo graph Estrapolare Geometria.dyn (Dynamo 2.1.0.7500)

# group: ESTRAI PUNTI INIZIALI E FINALI DA TRAVI ANALITICHE
# note: IPOTESI:
# -Tutti i telai sono orditi lungo Y e uguali tra di loro
# -Tutte le colonne hanno la medesima sezione
# -Tutte le travi di un singolo piano hanno la medesima sezione
# -Solo le travi sismoresistenti hanno modello analitico
# -Ad ogni Level corrisponde un piano dell'edificio
# -I telai hanno lo stesso passo di campata e di interpiano
categories = Categories("OST_BeamAnalytical")
all_elements_of_category = ElementsOfCategory(Category=categories)
geometry = Element.Geometry(element=all_elements_of_category)
# note: RESTITUISCE WARNING SE CI SONO TRAVI A GRAVITA', TUTTO NORMALE
byJoinedCurves = PolyCurve.ByJoinedCurves(curves=geometry)
clean = List.Clean(list=byJoinedCurves)
code_block = CodeBlock(x=clean) { x.EndPoint; x.StartPoint; }
join = List.Join(list0=code_block.out0, list1=code_block.out1)

# group: ELIMINO DOPPIONI E DIVIDO I NODI PER CIASCUN TELAIO
delete_duplicates = Python(IN[0]=join)
# ---------- delete_duplicates.python (13 lines) ----------
# Load the Python Standard and DesignScript Libraries
import sys
import clr
clr.AddReference('ProtoGeometry')
from Autodesk.DesignScript.Geometry import *

# The inputs to this node will be stored as a list in the IN variables.
input = IN[0]

# Place your code below this line

# Assign your output to the OUT variable.
OUT = set(input);
# ----------------------------------------
dividi_per_telaio = Python(IN[0]=delete_duplicates)
# ---------- dividi_per_telaio.python (28 lines) ----------
# Load the Python Standard and DesignScript Libraries
import sys
import clr
clr.AddReference('ProtoGeometry')
from Autodesk.DesignScript.Geometry import *

# The inputs to this node will be stored as a list in the IN variables.
input = IN[0]

# Place your code below this line
x_coordinates = []
points_by_frame = []

for element in input:
	x_coordinates.append(element.X)

x_coordinates = list(set(x_coordinates))
x_coordinates.sort()

for coordinate in x_coordinates:
	frame_points = []
	for element in input:
		if element.X == coordinate:
			frame_points.append(element)
	points_by_frame.append(frame_points)
			
# Assign your output to the OUT variable.
OUT = points_by_frame;
# ----------------------------------------
count = List.Count(list=dividi_per_telaio)

firstItem = List.FirstItem(list=dividi_per_telaio)
coordinates_y = Python(IN[0]=firstItem)
# ---------- coordinates_y.python (18 lines) ----------
# Load the Python Standard and DesignScript Libraries
import sys
import clr
clr.AddReference('ProtoGeometry')
from Autodesk.DesignScript.Geometry import *

# The inputs to this node will be stored as a list in the IN variables.
input = IN[0]

# Place your code below this line
y_coordinates = []

for element in input:
	y_coordinates.append(element.Y)

output = list(set(y_coordinates))
# Assign your output to the OUT variable.
OUT = output;
# ----------------------------------------

# group: CALCOLO LUNGHEZZA DELLA CAMPATA
sort = List.Sort(list=coordinates_y)
firstItem_2 = List.FirstItem(list=sort)
code_block_2 = CodeBlock { 1; }
getItemAtIndex = List.GetItemAtIndex(list=sort, index=code_block_2)
calcolo_campata = CodeBlock(x=firstItem_2, y=getItemAtIndex) { x - y; }

abs = Math.Abs(number=calcolo_campata)
mm_m = CodeBlock(x=abs) { x/1000; }

# group: OTTIENI QUOTE DEI PIANI
categories_2 = Categories("OST_Levels")
all_elements_of_category_2 = ElementsOfCategory(Category=categories_2)
elevations = Python(IN[0]=all_elements_of_category_2)
# ---------- elevations.python (15 lines) ----------
# Load the Python Standard and DesignScript Libraries
import sys
import clr
clr.AddReference('ProtoGeometry')
from Autodesk.DesignScript.Geometry import *

# The inputs to this node will be stored as a list in the IN variables.
input = IN[0]

# Place your code below this line
elevations = []
for element in input:
	elevations.append(round(element.Elevation))
# Assign your output to the OUT variable.
OUT = elevations;
# ----------------------------------------

# group: CALCOLO INTERPIANO
code_block_3 = CodeBlock { 1; }
getItemAtIndex_2 = List.GetItemAtIndex(list=elevations, index=code_block_3)

mm_m_2 = CodeBlock(x=getItemAtIndex_2) { x/1000; }

# group: A PARTIRE DAL NUMERO DI PIANI E I PUNTI DI UN SINGOLO TELAIO CALCOLO PIANI E CAMPATE
count_2 = List.Count(list=firstItem)
count_3 = List.Count(list=all_elements_of_category_2)
n1 = CodeBlock(x=count_3) { x-1; }  # "-1"
nodi_campate = CodeBlock(y=count_2, x=n1) { y/x-1; }

# group: ALTRI DATI TELAIO
massa_piano_tipo = CodeBlock { 314; }
massa_ultimo_piano = CodeBlock { 250; }
heff = CodeBlock { 12.52; }

calcolo_array_masse = Python(IN[0]=n1, IN[1]=massa_piano_tipo, IN[2]=massa_ultimo_piano)
# ---------- calcolo_array_masse.python (19 lines) ----------
# Load the Python Standard and DesignScript Libraries
import sys
import clr
clr.AddReference('ProtoGeometry')
from Autodesk.DesignScript.Geometry import *

# The inputs to this node will be stored as a list in the IN variables.
m = IN[0]
storey_mass = IN[1]
roof_mass = IN[2]

# Place your code below this line
output = [0]
for j in range(1,m):
	output.append(storey_mass)
output.append(roof_mass)
	
# Assign your output to the OUT variable.
OUT = output
# ----------------------------------------
masse = Watch(calcolo_array_masse)
heff_2 = Watch(heff)

# group: STEEL REINFORCEMENT
# note: PILASTRO
diameter = IntegerSlider(22, range=12..24 step 2)
number = IntegerSlider(2, range=1..2 step 1)
list_create = List.Create(item0=diameter, item1=number)
# note: TRAVE 1
diameter_2 = IntegerSlider(16, range=12..24 step 2)
number_2 = IntegerSlider(2, range=1..2 step 1)
list_create_2 = List.Create(item0=diameter_2, item1=number_2)
# note: TRAVE 2
diameter_3 = IntegerSlider(14, range=12..24 step 2)
number_3 = IntegerSlider(2, range=1..2 step 1)
list_create_3 = List.Create(item0=diameter_3, item1=number_3)
# note: TRAVE 3
diameter_4 = IntegerSlider(18, range=12..24 step 2)
number_4 = IntegerSlider(1, range=1..2 step 1)
list_create_4 = List.Create(item0=diameter_4, item1=number_4)
# note: TRAVE 4
diameter_5 = IntegerSlider(16, range=12..24 step 2)
number_5 = IntegerSlider(1, range=1..2 step 1)
list_create_5 = List.Create(item0=diameter_5, item1=number_5)
# note: TRAVE 5
diameter_6 = IntegerSlider(14, range=12..24 step 2)
number_6 = IntegerSlider(1, range=1..2 step 1)
list_create_6 = List.Create(item0=diameter_6, item1=number_6)
list_join_ma_fatto_bene = Python(IN[0]=list_create, IN[1]=list_create_2, IN[2]=list_create_3, IN[3]=list_create_4, IN[4]=list_create_5, IN[5]=list_create_6)
# ---------- list_join_ma_fatto_bene.python (16 lines) ----------
# Load the Python Standard and DesignScript Libraries
import sys
import clr
clr.AddReference('ProtoGeometry')
from Autodesk.DesignScript.Geometry import *

# The inputs to this node will be stored as a list in the IN variables.
input = IN

# Place your code below this line
output = []
for element in input:
	output.append(element)
	
# Assign your output to the OUT variable.
OUT = output
# ----------------------------------------

# group: POST TENSIONING
# note: COLONNA
number_7 = IntegerSlider(0, range=0..15 step 1)
tpti = CodeBlock { 0; }
list_create_7 = List.Create(item0=number_7, item1=tpti)
# note: TRAVE 1
number_8 = IntegerSlider(7, range=0..15 step 1)
tpti_2 = CodeBlock { 950; }
list_create_8 = List.Create(item0=number_8, item1=tpti_2)
# note: TRAVE 2
number_9 = IntegerSlider(6, range=0..15 step 1)
tpti_3 = CodeBlock { 800; }
list_create_9 = List.Create(item0=number_9, item1=tpti_3)
# note: TRAVE 3
number_10 = IntegerSlider(5, range=0..15 step 1)
tpti_4 = CodeBlock { 660; }
list_create_10 = List.Create(item0=number_10, item1=tpti_4)
# note: TRAVE 4
number_11 = IntegerSlider(4, range=0..15 step 1)
tpti_5 = CodeBlock { 500; }
list_create_11 = List.Create(item0=number_11, item1=tpti_5)
# note: TRAVE 5
number_12 = IntegerSlider(3, range=0..15 step 1)
tpti_6 = CodeBlock { 400; }
list_create_12 = List.Create(item0=number_12, item1=tpti_6)
list_join_ma_fatto_bene_2 = Python(IN[0]=list_create_7, IN[1]=list_create_8, IN[2]=list_create_9, IN[3]=list_create_10, IN[4]=list_create_11, IN[5]=list_create_12)  # same code as list_join_ma_fatto_bene

# group: OTTENGO b & h COLONNE NELL'IPOTESI CHE SIANO TUTTE UGUALI
categories_3 = Categories("OST_StructuralColumns")
all_elements_of_category_3 = ElementsOfCategory(Category=categories_3)
code_block_4 = CodeBlock { "Family"; }

code_block_5 = CodeBlock { "Enable Analytical Model"; }
getParameterValueByName = Element.GetParameterValueByName(element=all_elements_of_category_3, parameterName=code_block_5)
int_bool = CodeBlock(x=getParameterValueByName) { x == 1; }
filterByBoolMask = List.FilterByBoolMask(list=all_elements_of_category_3, mask=int_bool)

# group (continued): OTTENGO b & h COLONNE NELL'IPOTESI CHE SIANO TUTTE UGUALI
firstItem_3 = List.FirstItem(list=filterByBoolMask.in)
getParameterValueByName_2 = Element.GetParameterValueByName(element=firstItem_3, parameterName=code_block_4)
parameters = Element.Parameters(element=getParameterValueByName_2)
get_b_and_h = Python(IN[0]=parameters)
# ---------- get_b_and_h.python (15 lines) ----------
# Load the Python Standard and DesignScript Libraries
import sys
import clr
clr.AddReference('ProtoGeometry')
from Autodesk.DesignScript.Geometry import *

# The inputs to this node will be stored as a list in the IN variables.
input = IN[0]

# Place your code below this line
output = []
output.append(input[2])
output.append(input[10])
# Assign your output to the OUT variable.
OUT = output;
# ----------------------------------------

# group: OTTENGO b & h DELLE TRAVI PIANO PER PIANO
categories_4 = Categories("OST_StructuralFraming")
all_elements_of_category_4 = ElementsOfCategory(Category=categories_4)
code_block_6 = CodeBlock { "Family"; }
code_block_7 = CodeBlock { "Elevation at Top"; }
restOfItems = List.RestOfItems(list=elevations)

code_block_8 = CodeBlock { "Enable Analytical Model"; }
getParameterValueByName_3 = Element.GetParameterValueByName(element=all_elements_of_category_4, parameterName=code_block_8)
int_bool_2 = CodeBlock(x=getParameterValueByName_3) { x == 1; }
filterByBoolMask_2 = List.FilterByBoolMask(list=all_elements_of_category_4, mask=int_bool_2)

# group (continued): OTTENGO b & h DELLE TRAVI PIANO PER PIANO
getParameterValueByName_4 = Element.GetParameterValueByName(element=filterByBoolMask_2.in, parameterName=code_block_6)
parameters_2 = Element.Parameters(element=getParameterValueByName_4)
get_b_and_h_2 = Python(IN[0]=parameters_2)
# ---------- get_b_and_h_2.python (19 lines) ----------
# Load the Python Standard and DesignScript Libraries
import sys
import clr
clr.AddReference('ProtoGeometry')
from Autodesk.DesignScript.Geometry import *

# The inputs to this node will be stored as a list in the IN variables.
input = IN[0]

# Place your code below this line
sections = []
for element in input:
	section = []
	section.append(element[2])
	section.append(element[11])
	sections.append(section)

# Assign your output to the OUT variable.
OUT = sections;
# ----------------------------------------
getParameterValueByName_5 = Element.GetParameterValueByName(element=filterByBoolMask_2.in, parameterName=code_block_7)
round = Math.Round(number=getParameterValueByName_5)
create_filter = Python(IN[0]=round, IN[1]=restOfItems)
# ---------- create_filter.python (26 lines) ----------
# Load the Python Standard and DesignScript Libraries
import sys
import clr
clr.AddReference('ProtoGeometry')
from Autodesk.DesignScript.Geometry import *

# The inputs to this node will be stored as a list in the IN variables.
beams = IN[0]
elevations = IN[1]

# Place your code below this line
def condition(elevation, beam):
	return elevation == beam
	
number_of_beams = []
for elevation in elevations:
	number_of_beams.append(sum(condition(elevation, beam) for beam in beams))
	
filter = []	
for number in number_of_beams:
	filter.append(True)
	for i in range(1,4):
		filter.append(False)
	
# Assign your output to the OUT variable.
OUT = filter
# ----------------------------------------
filterByBoolMask_3 = List.FilterByBoolMask(list=get_b_and_h_2, mask=create_filter)

# group: FORMATTO I DATI DELLE SEZIONI
string_from_object = FromObject(obj=get_b_and_h)
code_block_9 = CodeBlock { 0; 4; }
remove = String.Remove(str=string_from_object, startIndex=code_block_9.out0, count=code_block_9.out1)
toNumber = String.ToNumber(str=remove)
mm_m_3 = CodeBlock(x=toNumber) { x/1000; }
string_from_object_2 = FromObject(obj=filterByBoolMask_3.in)
remove_2 = String.Remove(str=string_from_object_2, startIndex=code_block_9.out0, count=code_block_9.out1)
toNumber_2 = String.ToNumber(str=remove_2)
mm_m_4 = CodeBlock(x=toNumber_2) { x/1000; }

addItemToFront = List.AddItemToFront(item=mm_m_3, list=mm_m_4)

# group: CHECK OUTPUT
nodi = Watch(firstItem)
campata = Watch(mm_m)
# note: INFORMAZIONI ELABORATE
altezza_interpiano = Watch(mm_m_2)
numero_di_campate = Watch(nodi_campate)
numero_di_piani = Watch(n1)
numero_di_telai = Watch(count)
b_e_h_sezioni_0_è_colone = Watch(addItemToFront)

round_2 = Math.Round(number=numero_di_campate)

# group: OTHER SECTION OPTIONS
kcon_column = CodeBlock { 0.55; }
kcon_beam = CodeBlock { 0.7; }
c = CodeBlock { -0.1; }
N = CodeBlock { 940; }

creazione_dei_dizionari = Python(IN[0]=list_join_ma_fatto_bene, IN[1]=list_join_ma_fatto_bene_2, IN[2]=b_e_h_sezioni_0_è_colone, IN[3]=kcon_column, IN[4]=kcon_beam, IN[5]=c, IN[6]=N)
# ---------- creazione_dei_dizionari.python (49 lines) ----------
# Load the Python Standard and DesignScript Libraries
import sys
import clr
clr.AddReference('ProtoGeometry')
from Autodesk.DesignScript.Geometry import *

# The inputs to this node will be stored as a list in the IN variables.
reinforcement = IN[0]
postTensioning = IN[1]
sections = IN[2]
kcon_column = IN[3]
kcon_beam = IN[4]
c = IN[5]
N_column = IN[6]

# Place your code below this line
dizionari = []

for j in range(len(reinforcement)):
	
	if j == 0:
	
		dizionario = {
			"b" 			: 	sections[j][0],
			"h" 			: 	sections[j][1],
			"c"				:	c,
			"Kcon"			:	kcon_column,
			"Reinforcement" :	reinforcement[j],
			"Tensioning"	:	postTensioning[j],
			"AxialLoad"		:	N_column
			}
	
	else:
	
		dizionario = {
			"b" 			: 	sections[j][0],
			"h" 			: 	sections[j][1],
			"c"				:	c,
			"Kcon"			:	kcon_beam,
			"Reinforcement" :	reinforcement[j],
			"Tensioning"	:	postTensioning[j],
			"AxialLoad"		:	0
			}
	
	dizionari.append(dizionario)
		

# Assign your output to the OUT variable.
OUT = dizionari
# ----------------------------------------

# group: CREAZIONE DEL JSON OBJECT
indici = CodeBlock()
# ---------- indici.designscript (8 lines) ----------
[ "span" ,
"storey" ,
"n" ,
"m",
"r",
"mass",
"Heff",
"sections"];
# ----------------------------------------
# note: I METODI DI DYNAMO FANNO PENA
list_join_ma_fatto_bene_3 = Python(IN[0]=campata, IN[1]=altezza_interpiano, IN[2]=round_2, IN[3]=numero_di_piani, IN[4]=numero_di_telai, IN[5]=masse, IN[6]=heff_2, IN[7]=creazione_dei_dizionari)  # same code as list_join_ma_fatto_bene
byKeysValues = DesignScript.Builtin.Dictionary.ByKeysValues(keys=indici, values=list_join_ma_fatto_bene_3)
dizionario_di_output = Watch(byKeysValues)
byDictionary = JsonData.Elements.JsonObject.ByDictionary(dictionary=dizionario_di_output)
JSON = Watch(byDictionary)

# group: SCRITTURA OUTPUT
file_path = Filename("..\..\OSPY_2.0\Input\Telaio.json")
toJsonFile = JsonData.Utilities.Write.ToJsonFile(jsonObjects=JSON, filepath=file_path)

# group: PUSHOVER
indici_2 = CodeBlock()
# ---------- indici_2.designscript (2 lines) ----------
[ "points",
"step"];
# ----------------------------------------
punti_pushover = CodeBlock { [0.1, -0.1, 0.2, -0.2, 0.3, -0.3, 0.4, -0.4, 0.4]; }
STEP = CodeBlock { 0.005; }
list_join_ma_fatto_bene_4 = Python(IN[0]=punti_pushover, IN[1]=STEP)  # same code as list_join_ma_fatto_bene
byKeysValues_2 = DesignScript.Builtin.Dictionary.ByKeysValues(keys=indici_2, values=list_join_ma_fatto_bene_4)
byDictionary_2 = JsonData.Elements.JsonObject.ByDictionary(dictionary=byKeysValues_2)
JSON_2 = Watch(byDictionary_2)

# group: SCRITTURA OUTPUT
file_path_2 = Filename("..\..\OSPY_2.0\Input\Pushover.json")
toJsonFile_2 = JsonData.Utilities.Write.ToJsonFile(jsonObjects=JSON_2, filepath=file_path_2)

# group: TIMEHISTORY
code_block_10 = CodeBlock { "TimeHistory"; }
code_block_11 = CodeBlock()
# ---------- code_block_11.designscript (5 lines) ----------
["id",
"dt",
"sf",
"duration",
"TimeStepRatio"];
# ----------------------------------------
timeStepRatio = CodeBlock { 1; }
KALAMATA = CodeBlock(x=timeStepRatio) { 1; 0.005; 0.01; 35.875; x; }
list_create_13 = List.Create(item0=KALAMATA.out0, item1=KALAMATA.out1, item2=KALAMATA.out2, item3=KALAMATA.out3, item4=KALAMATA.x)
byKeysValues_3 = DesignScript.Builtin.Dictionary.ByKeysValues(keys=code_block_11, values=list_create_13)
AMATRICE = CodeBlock(x=timeStepRatio) { 2; 0.005; 0.01; 27.895; x; }
list_create_14 = List.Create(item0=AMATRICE.out0, item1=AMATRICE.out1, item2=AMATRICE.out2, item3=AMATRICE.out3, item4=AMATRICE.x)
byKeysValues_4 = DesignScript.Builtin.Dictionary.ByKeysValues(keys=code_block_11, values=list_create_14)
aquila_k = CodeBlock(x=timeStepRatio) { 3; 0.005; 0.01; 100.000; x; }
list_create_15 = List.Create(item0=aquila_k.out0, item1=aquila_k.out1, item2=aquila_k.out2, item3=aquila_k.out3, item4=aquila_k.x)
byKeysValues_5 = DesignScript.Builtin.Dictionary.ByKeysValues(keys=code_block_11, values=list_create_15)
aquila_v = CodeBlock(x=timeStepRatio) { 4; 0.005; 0.01; 100.005; x; }
list_create_16 = List.Create(item0=aquila_v.out0, item1=aquila_v.out1, item2=aquila_v.out2, item3=aquila_v.out3, item4=aquila_v.x)
byKeysValues_6 = DesignScript.Builtin.Dictionary.ByKeysValues(keys=code_block_11, values=list_create_16)
NORCIA = CodeBlock(x=timeStepRatio) { 5; 0.005; 0.01; 60.000; x; }
list_create_17 = List.Create(item0=NORCIA.out0, item1=NORCIA.out1, item2=NORCIA.out2, item3=NORCIA.out3, item4=NORCIA.x)
byKeysValues_7 = DesignScript.Builtin.Dictionary.ByKeysValues(keys=code_block_11, values=list_create_17)
emilia_m = CodeBlock(x=timeStepRatio) { 6; 0.005; 0.01; 62.005; x; }
list_create_18 = List.Create(item0=emilia_m.out0, item1=emilia_m.out1, item2=emilia_m.out2, item3=emilia_m.out3, item4=emilia_m.x)
byKeysValues_8 = DesignScript.Builtin.Dictionary.ByKeysValues(keys=code_block_11, values=list_create_18)
emilia_q = CodeBlock(x=timeStepRatio) { 7; 0.005; 0.01; 170.005; x; }
list_create_19 = List.Create(item0=emilia_q.out0, item1=emilia_q.out1, item2=emilia_q.out2, item3=emilia_q.out3, item4=emilia_q.x)
byKeysValues_9 = DesignScript.Builtin.Dictionary.ByKeysValues(keys=code_block_11, values=list_create_19)
list_join_ma_fatto_bene_5 = Python(IN[0]=byKeysValues_3, IN[1]=byKeysValues_4, IN[2]=byKeysValues_5, IN[3]=byKeysValues_6, IN[4]=byKeysValues_7, IN[5]=byKeysValues_8, IN[6]=byKeysValues_9)  # same code as list_join_ma_fatto_bene

list_join_ma_fatto_bene_6 = Python(IN[0]=list_join_ma_fatto_bene_5)  # same code as list_join_ma_fatto_bene

# group (continued): TIMEHISTORY
byKeysValues_10 = DesignScript.Builtin.Dictionary.ByKeysValues(keys=code_block_10, values=list_join_ma_fatto_bene_6)
byDictionary_3 = JsonData.Elements.JsonObject.ByDictionary(dictionary=byKeysValues_10)
JSON_3 = Watch(byDictionary_3)

# group: SCRITTURA OUTPUT
file_path_3 = Filename("..\..\OSPY_2.0\Input\TimeHistory.json")
toJsonFile_3 = JsonData.Utilities.Write.ToJsonFile(jsonObjects=JSON_3, filepath=file_path_3)

code_block_12 = CodeBlock()
# ---------- code_block_12.designscript (2 lines) ----------
["YieldStress",
"r"];
# ----------------------------------------

# group: ACCIAIO B450C
yield_stress_mpa = CodeBlock { 450; }
# note: Default ultimate Strain 6%
rapporto_di_incrudimento = CodeBlock { 0.0074; }

mpa_kpa = CodeBlock(x=yield_stress_mpa) { x*1000; }
list_create_20 = List.Create(item0=mpa_kpa, item1=rapporto_di_incrudimento)
byKeysValues_11 = DesignScript.Builtin.Dictionary.ByKeysValues(keys=code_block_12, values=list_create_20)
dizionario_di_output_2 = Watch(byKeysValues_11)
byDictionary_4 = JsonData.Elements.JsonObject.ByDictionary(dictionary=dizionario_di_output_2)
JSON_4 = Watch(byDictionary_4)

# group: SCRITTURA OUTPUT
file_path_4 = Filename("..\..\OSPY_2.0\Input\Steel.json")
toJsonFile_4 = JsonData.Utilities.Write.ToJsonFile(jsonObjects=JSON_4, filepath=file_path_4)

code_block_13 = CodeBlock()
# ---------- code_block_13.designscript (3 lines) ----------
["YieldStress",
"Young",
"G"];
# ----------------------------------------

# group: LVL TIMBER
parallel_capacity_mpa = CodeBlock { 50; }
young_module_mpa = CodeBlock { 13600; }
g_module_mpa = CodeBlock { 660; }

mpa_kpa_2 = CodeBlock(x=parallel_capacity_mpa) { x*1000; }
mpa_kpa_3 = CodeBlock(x=young_module_mpa) { x*1000; }
mpa_kpa_4 = CodeBlock(x=g_module_mpa) { x*1000; }
list_create_21 = List.Create(item0=mpa_kpa_2, item1=mpa_kpa_3, item2=mpa_kpa_4)
byKeysValues_12 = DesignScript.Builtin.Dictionary.ByKeysValues(keys=code_block_13, values=list_create_21)
dizionario_di_output_3 = Watch(byKeysValues_12)
byDictionary_5 = JsonData.Elements.JsonObject.ByDictionary(dictionary=dizionario_di_output_3)
JSON_5 = Watch(byDictionary_5)

# group: SCRITTURA OUTPUT
file_path_5 = Filename("..\..\OSPY_2.0\Input\Timber.json")
toJsonFile_5 = JsonData.Utilities.Write.ToJsonFile(jsonObjects=JSON_5, filepath=file_path_5)

code_block_14 = CodeBlock()
# ---------- code_block_14.designscript (3 lines) ----------
["YieldStress",
"Young",
"Area"];
# ----------------------------------------

# group: TREFOLI 0.6" SUPER ARCELORMITTAL
yield_stress_mpa_2 = CodeBlock { 1670; }
young_module_gpa = CodeBlock { 200; }
tendon_area_mm2 = CodeBlock { 139; }

mpa_kpa_5 = CodeBlock(x=yield_stress_mpa_2) { x*1000; }
gpa_kpa = CodeBlock(x=young_module_gpa) { x*1000000; }
list_create_22 = List.Create(item0=mpa_kpa_5, item1=gpa_kpa, item2=tendon_area_mm2)
byKeysValues_13 = DesignScript.Builtin.Dictionary.ByKeysValues(keys=code_block_14, values=list_create_22)
dizionario_di_output_4 = Watch(byKeysValues_13)
byDictionary_6 = JsonData.Elements.JsonObject.ByDictionary(dictionary=dizionario_di_output_4)
JSON_6 = Watch(byDictionary_6)

# group: SCRITTURA OUTPUT
file_path_6 = Filename("..\..\OSPY_2.0\Input\Tendon.json")
toJsonFile_6 = JsonData.Utilities.Write.ToJsonFile(jsonObjects=JSON_6, filepath=file_path_6)

code_block_15 = CodeBlock {  }
code_block_16 = CodeBlock {  }
